# Grasshopper definition Woven Sketching Tool.gh (Grasshopper 1.0.7)
# plug-ins: Kangaroo2 Components

# ---- group: Grid size
# 1. Set grid size
extent_x = Slider(36, range=0..100)
extent_y = Slider(48, range=0..100)

# ---- group: Points to join
geo = Geometry()

# ---- group: Points to exchange
# 2. Select grid points
# to join or exchange
geo_2 = Geometry([<curve referenced from the Rhino model> x2])

# ----
join_at_edges = BooleanToggle(False)

# ---- group: Optional - points to filter + join
geo_3 = Geometry(<curve referenced from the Rhino model>)

# ----
invert = BooleanToggle(False)
invert_2 = BooleanToggle(False)
invert_3 = BooleanToggle(False)

# ---- group: No filter
panel = Panel("{?;?}[?]")

# ---- group: Plain weave
# 2b. (Optional)
# Apply a filter to
# joined points
panel_2 = Panel("""{?;(0,2,…)}[(1,3,…)]
{?;(1,3,…)}[(0,2,…)]""")

# ---- group: 2x1 twill
panel_3 = Panel("""{?;(0,3,…)}[(0,3,…)]
{?;(1,4,…)}[(1,4,…)]
{?;(2,5,…)}[(2,5,…)]""")

# ---- group: 3x1 broken twill
panel_4 = Panel("""{?;(0,4,…)}[(0,4,…)]
{?;(1,5,…)}[(2,6,…)]
{?;(2,6,…)}[(1,5,…)]
{?;(3,7,…)}[(3,7,…)]""")

# ---- group: 6 shaft satin
panel_5 = Panel("""{?;(0,6,…)}[(0,6,…)]
{?;(1,7,…)}[(2,8,…)]
{?;(2,8,…)}[(4,10,…)]
{?;(3,9,…)}[(1,7,…)]
{?;(4,10,…)}[(5,11,…)]
{?;(5,11,…)}[(3,9,…)]""")

# ---- group: 8 shaft satin
panel_6 = Panel("""{?;(0,8,…)}[(0,8,…)]
{?;(1,9,…)}[(5,13,…)]
{?;(2,10,…)}[(2,10,…)]
{?;(3,11,…)}[(7,15,…)]
{?;(4,12,…)}[(4,12,…)]
{?;(5,13,…)}[(1,9,…)]
{?;(6,14,…)}[(6,14,…)]
{?;(7,15,…)}[(3,11,…)]""")

# ---- group: 8 shaft satin with 1 empty row/column
panel_7 = Panel("""{?;(0,8,…)}[(0,8,…)]
{?;(1,9,…)}[(5,13,…)]
{?;(2,10,…)}[(2,10,…)]
{?;(3,11,…)}[(7,15,…)]

{?;(5,13,…)}[(1,9,…)]
{?;(6,14,…)}[(6,14,…)]
{?;(7,15,…)}[(3,11,…)]""")

# ---- group: 10x10 gridlines
# {?;(0 to 10)}[(0 to 10)]
# {?;(20 to 30)}[(0 to 10)]
# {?;(10 to 20)}[(10 to 20)]
# {?;(30 to 40)}[(10 to 20)]
# {?;(0 to 10)}[(20 to 30)]
# {?;(20 to 30)}[(20 to 30)]
# {?;(10 to 20)}[(30 to 40)]
# {?;(30 to 40)}[(30 to 40)]
panel_8 = Panel("""{?;(8,18,28)}[(0 to 48)]
{?;(0 to 48)}[(9,19,29,39)]""")

# ---- group: Layer 0 A-curves
geo_4 = Geometry([<curve referenced from the Rhino model> x2])

# ---- group: Layer 1 A-curves
# 4. Set params for
# each zone
geo_5 = Geometry([<curve referenced from the Rhino model> x2])

# ---- group: Shrinkage params
_0_a_warp = Slider(1, range=0..1)
_0_b_warp = Slider(0.5, range=0..1)
_0_a_weft = Slider(1, range=0..1)
_0_b_weft = Slider(0.5, range=0..1)
_1_a_warp = Slider(0.8, range=0..1)
_1_b_warp = Slider(0.5, range=0..1)
_1_a_weft = Slider(0.6, range=0..1)
_1_b_weft = Slider(0.5, range=0..1)
entwine = Entwine(
    Branch00=_0_a_warp,
    Branch01=_0_b_warp,
    Branch02=_0_a_weft,
    Branch03=_0_b_weft,
    Branch04=_1_a_warp,
    Branch05=_1_b_warp,
    Branch06=_1_a_weft,
    Branch07=_1_b_weft,
    FlattenInputs=True)

# ---- group: Stiffness params
_0_a_warp_2 = Slider(0.8, range=0..1)
_0_a_weft_2 = Slider(1, range=0..1)
_1_a_warp_2 = Slider(1, range=0..1)
_1_a_weft_2 = Slider(1, range=0..1)
_0_b_warp_2 = Slider(0, range=0..1)
_0_b_weft_2 = Slider(0, range=0..1)
_1_b_warp_2 = Slider(0, range=0..1)
_1_b_weft_2 = Slider(0, range=0..1)
entwine_2 = Entwine(
    Branch00=_0_a_warp_2,
    Branch01=_0_b_warp_2,
    Branch02=_0_a_weft_2,
    Branch03=_0_b_weft_2,
    Branch04=_1_a_warp_2,
    Branch05=_1_b_warp_2,
    Branch06=_1_a_weft_2,
    Branch07=_1_b_weft_2,
    FlattenInputs=True)

# ----
# 3. Define A/B zones
# for each layer
cluster = Cluster_11(extent_x=extent_x, extent_y=extent_y)  # -> layer_0_pts, layer_1_pts, all_cells_on_all_layers, all_points_on_all_layers
# 2a. (Optional) Re-assign
# behaviors to selection sets
cluster_2 = Cluster_25(
    selection_curve_1=geo_2,
    invert_1=invert,
    selection_curve_2=geo,
    invert_2=invert_2,
    selection_curve_3=geo_3,
    invert_3=invert_3,
    all_pts_all_layers=cluster.all_points_on_all_layers)  # -> set_1, set_2, set_3
invert_4 = BooleanToggle(False)
invert_5 = BooleanToggle(True)
cluster_3 = Cluster_23(
    layer_0_pts=cluster.layer_0_pts,
    layer_0_a_curves=geo_4,
    invert_0_a=invert_4,
    layer_1_pts=cluster.layer_1_pts,
    layer_1_a_curves=geo_5,
    invert_1_a=invert_5,
    shrinkage_params=entwine,
    stiffness_params=entwine_2)  # -> layer_0_rel_tree, layer_1_rel_tree, shrinkage_goals, stiffness_goals
cluster_4 = Cluster_9(
    layer_0_pts=cluster.layer_0_pts,
    layer_0_rel_tree=cluster_3.layer_0_rel_tree,
    layer_1_pts=cluster.layer_1_pts,
    layer_1_rel_tree=cluster_3.layer_1_rel_tree,
    all_cells_on_all_layers=cluster.all_cells_on_all_layers,
    all_points_on_all_layers=cluster.all_points_on_all_layers)  # -> show_0_a_pts, show_1_a_pts, show_lines, show_pts, world_goals
cluster_5 = Cluster_41(
    all_points_on_all_layers=cluster.all_points_on_all_layers,
    pts_to_swap=cluster_2.set_1,
    pts_to_join=cluster_2.set_2,
    filter=panel_7,
    pts_to_filter_and_join=cluster_2.set_3,
    join_at_edges=join_at_edges,
    extent_x=extent_x,
    extent_y=extent_y)  # -> column_goals, joining_layer_separation_goals, show_join_pts, tree_of_filtered_joined_pts, show_layer_separation_lines, show_swap_pts
entwine_3 = Entwine(
    Branch00=cluster_4.show_0_a_pts,
    Branch01=cluster_4.show_1_a_pts,
    Branch02=cluster_4.show_lines,
    Branch03=cluster_4.show_pts,
    Branch04=cluster_4.world_goals,
    Branch05=cluster_3.shrinkage_goals,
    Branch06=cluster_3.stiffness_goals,
    Branch07=cluster_5.column_goals,
    Branch08=cluster_5.joining_layer_separation_goals,
    Branch09=cluster_5.show_join_pts,
    Branch010=cluster_5.show_layer_separation_lines,
    Branch011=cluster_5.show_swap_pts,
    FlattenInputs=True)
display_points_w_offset = Slider(0.2, range=0..0.4)

# ---- group: U count for NURBS surfaces
expression = Expression(x=extent_x, Expression="x+1")

# ----
reset = Button()
running = BooleanToggle(False)
solver = Solver(GoalObjects=entwine_3, Reset=reset, Threshold=1e-15, Tolerance=0.01, On=running)  # -> I, V, simplify(O)
cluster_6 = Cluster_14(output=solver.O, offset=display_points_w_offset)  # -> layer_0_lines, layer_1_lines, layer_0_pts, layer_1_pts, anchors, vectors, join_pts, exchange_pts, _0_a_pts, _1_a_pts

# ---- group: Join pts
preview = CustomPreview(Geometry=cluster_6.join_pts, Material=ColourSwatch(SwatchColor=RGB(0, 0, 0)))

# ---- group: Layer 0 lines
# 5. Set display options
preview_2 = CustomPreview(Geometry=cluster_6.layer_0_lines, Material=ColourSwatch(SwatchColor=RGB(255, 0, 0)))

# ---- group: Layer 1 lines
preview_3 = CustomPreview(Geometry=cluster_6.layer_1_lines, Material=ColourSwatch(SwatchColor=RGB(0, 51, 255)))

# ---- group: Layer 0 pts
# 6. Start solver
preview_4 = CustomPreview(Geometry=cluster_6.layer_0_pts, Material=ColourSwatch(SwatchColor=RGB(255, 0, 0)))

# ---- group: Layer 1 pts
preview_5 = CustomPreview(Geometry=cluster_6.layer_1_pts, Material=ColourSwatch(SwatchColor=RGB(0, 51, 255)))

# ---- group: Exchange pts
preview_6 = CustomPreview(Geometry=cluster_6.exchange_pts, Material=ColourSwatch(SwatchColor=RGB(255, 255, 0)))

# ---- group: 0-A pts
preview_7 = CustomPreview(Geometry=cluster_6._0_a_pts, Material=ColourSwatch(SwatchColor=RGB(255, 0, 255)))

# ----
layer_0_surface = BooleanToggle(False)
cluster_7 = Cluster_12(
    pts=cluster_6.layer_0_pts,
    on_off=layer_0_surface,
    u_count=expression,
    color=ColourSwatch(SwatchColor=RGB(255, 255, 255)))  # -> surface, M
preview_8 = CustomPreview(Geometry=cluster_7.surface, Material=cluster_7.M)

layer_1_surface = BooleanToggle(False)
cluster_8 = Cluster_12(
    pts=cluster_6.layer_1_pts,
    on_off=layer_1_surface,
    u_count=expression,
    color=ColourSwatch(SwatchColor=RGB(196, 220, 255)))  # -> surface, M
preview_9 = CustomPreview(Geometry=cluster_8.surface, Material=cluster_8.M)

# ---- group: 1-A pts
preview_10 = CustomPreview(Geometry=cluster_6._1_a_pts, Material=ColourSwatch(SwatchColor=RGB(0, 195, 255)))

# ---- group: Vectors b/w layers
vdis = VectorDisplay(Anchor=cluster_6.anchors, Vector=cluster_6.vectors)

# ----
# 7. Show color mapping
show_color_mapping = BooleanToggle(False)
cluster_9 = Cluster_29(
    show_color_mapping=show_color_mapping,
    layer_0_a_curves=geo_4,
    _0_a_inverted=invert_4,
    layer_1_a_curves=geo_5,
    _1_a_inverted=invert_5,
    exchange_curves=geo_2,
    exchange_curves_inverted=invert,
    join_curves=geo,
    join_curves_inverted=invert_2,
    filter_join_curves=geo_3,
    filter_join_curves_inverted=invert_3,
    relay=cluster_5.tree_of_filtered_joined_pts,
    extent_x=extent_x,
    extent_y=extent_y)  # -> all_fills, all_colors
ghatch = GradientHatch(
    Boundaries=cluster_9.all_fills,
    Axis=Line((0, 0, 0), (1, 0, 0)),
    Colour1=cluster_9.all_colors,
    Colour2=cluster_9.all_colors)

show_color_palette = BooleanToggle(False)
cluster_10 = Cluster_26(show_color_palette=show_color_palette, all_colors=cluster_9.all_colors, extent_x=extent_x, extent_y=extent_y)  # -> colors, swatches, label_1_locations, label_1_text, label_2_locations, label_2_text
ghatch_2 = GradientHatch(Boundaries=cluster_10.swatches, Axis=Line((0, 0, 0), (1, 0, 0)), Colour1=cluster_10.colors, Colour2=cluster_10.colors)
tag = TextTag3D(Location=cluster_10.label_1_locations, Text=cluster_10.label_1_text, Size=1, Colour=RGB(0, 0, 0), Justification=4)
tag_2 = TextTag3D(Location=cluster_10.label_2_locations, Text=cluster_10.label_2_text, Size=1, Colour=RGB(0, 0, 0), Justification=8)

ln = Line(StartPoint=Point(0, 0, 0), EndPoint=Point(0, 0, 1))
# 5. Goals
# 6. Show outputs
# 4. Choose a filter and choose
# masks to use in pre- and
# post-filter selection steps
merge = Merge(Data1=graft(ln), Data2=ln)

# ---- group: Layer joins
length_line = LengthLine(Line=merge, Length=Slider(0.1, range=0..1), Strength=10)

# ---- group: Stiffness
stiffness = Slider(1, range=0..1)
expression_2 = Expression(x=stiffness, Expression="abs(1-x)*π")
clampangle = ClampAngle(LineA=merge, LineB=merge, UpperLimit=expression_2, LowerLimit=0.7853981634, Strength=1)

# ----
enabled = BooleanToggle(True)
panel_9 = Panel(enabled)
panel_10 = Panel(length_line)
panel_11 = Panel(clampangle)

# ---- group: Shrinkage
shrinkage = Slider(1, range=0..1)
len = Length(Curve=merge)
multiplication = Multiplication(A=len, B=shrinkage)
length_line_2 = LengthLine(Line=merge, Length=multiplication, Strength=10)

# ---- group: Layer intersections
path_mapper = PathMapper(merge, source="{A;B}", target="{(A+1)%2;B}")
merge_2 = Merge(Data1=path_mapper, Data2=merge)

# ----
enabled_2 = BooleanToggle(True)
panel_12 = Panel(length_line_2)
panel_13 = Panel(merge_2)
panel_14 = Panel(enabled_2)

# ==== cluster Cluster_9
all_points_on_all_layers = ClusterInput()
all_cells_on_all_layers = ClusterInput()
layer_0_rel_tree = ClusterInput()
layer_1_rel_tree = ClusterInput()
layer_0_pts = ClusterInput()
layer_1_pts = ClusterInput()

cluster = Cluster_4(all_points_on_all_layers=all_points_on_all_layers)
cluster_2 = Cluster_7(all_points_on_all_layers=all_points_on_all_layers)
cluster_3 = Cluster_5()
cluster_4 = Cluster_6()
cluster_5 = Cluster(all_cells_on_all_layers=all_cells_on_all_layers)
cluster_6 = Cluster_3(layer_1_pts=layer_1_pts, layer_1_rel_tree=layer_1_rel_tree)
cluster_7 = Cluster_8(all_points_on_all_layers=all_points_on_all_layers)
cluster_8 = Cluster_2(layer_0_pts=layer_0_pts, layer_0_rel_tree=layer_0_rel_tree)

# ---- group: World goals
entwine = Entwine(Branch00=cluster_4, Branch01=cluster_3, Branch02=cluster, Branch03=cluster_2, FlattenInputs=True)

# ----
show_pts = ClusterOutput(cluster_7)
show_lines = ClusterOutput(cluster_5)
show_1_a_pts = ClusterOutput(cluster_6)
world_goals = ClusterOutput(entwine)
show_0_a_pts = ClusterOutput(cluster_8)

# ==== cluster Cluster_11
extent_y = ClusterInput()
extent_x = ClusterInput()

# ---- group: Create layers
cluster = Cluster_10(X=extent_x, Y=extent_y)  # -> layer_0_cells, layer_0_pts, layer_1_cells, layer_1_pts

# ---- group: Get cell and point trees
get_point_and_cell_tree = GetPointAndCellTree(
    layer_0_cells=cluster.layer_0_cells,
    layer_1_cells=cluster.layer_1_cells,
    extent_y=extent_y,
    layer_0_pts=cluster.layer_0_pts,
    layer_1_pts=cluster.layer_1_pts)  # -> all_cells_on_all_layers, all_points_on_all_layers

# ----
layer_1_pts = ClusterOutput(cluster.layer_1_pts)
layer_0_pts = ClusterOutput(cluster.layer_0_pts)
all_cells_on_all_layers = ClusterOutput(get_point_and_cell_tree.all_cells_on_all_layers)
all_points_on_all_layers = ClusterOutput(get_point_and_cell_tree.all_points_on_all_layers)

# ==== cluster Cluster_12
on_off = ClusterInput()
u_count = ClusterInput()
pts = ClusterInput()
color = ClusterInput()

dispatch = Dispatch(List=pts, DispatchPattern=on_off)  # -> ListA, ListB
srfgrid = SurfaceFromPoints(Points=dispatch.ListA, UCount=u_count, Interpolate=False)

material = CreateMaterial(
    Diffuse=color,
    Specular=RGB(255, 255, 255),
    Emission=ColourSwatch(SwatchColor=RGB(26, 26, 26)),
    Transparency=Slider(0.2, range=0..1),
    Shine=0)

M = ClusterOutput(material)
surface = ClusterOutput(srfgrid)

# ==== cluster Cluster_14
output = ClusterInput()
offset = ClusterInput()
bang = ExplodeTree(Data=output)  # -> Branch0, Branch1, Branch2, Branch3, Branch4, Branch5, Branch6, Branch7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

end = EndPoints(Curve=bang.Branch10)  # -> Start, End
dispatch = Dispatch(List=bang.Branch2, DispatchPattern=[True, False])  # -> ListA, ListB
dispatch_2 = Dispatch(List=bang.Branch3, DispatchPattern=[True, False])  # -> ListA, ListB
cluster = Cluster_13(join_pts=bang.Branch9, exchange_pts=bang.Branch11, _0_a_pts=bang.Branch0, _1_a_pts=bang.Branch1, offset=offset)  # -> join_pts_2, exchange_pts_2, _0_a_pts_2, _1_a_pts_2
duppt = RemoveDuplicatePts(Points=dispatch_2.ListB, Tolerance=0.01)
duppt_2 = RemoveDuplicatePts(Points=dispatch_2.ListA, Tolerance=0.01)
vec2pt = Vector2Pt(PointA=end.Start, PointB=end.End, Unitize=False)  # -> Vector, Length

vectors = ClusterOutput(vec2pt.Vector)
anchors = ClusterOutput(end.Start)
layer_1_pts = ClusterOutput(duppt)
layer_0_pts = ClusterOutput(duppt_2)
join_pts = ClusterOutput(cluster.join_pts_2)
exchange_pts = ClusterOutput(cluster.exchange_pts_2)
_0_a_pts = ClusterOutput(cluster._0_a_pts_2)
_1_a_pts = ClusterOutput(cluster._1_a_pts_2)
layer_0_lines = ClusterOutput(dispatch.ListA)
layer_1_lines = ClusterOutput(dispatch.ListB)

# ==== cluster Cluster_23
layer_0_a_curves = ClusterInput()
layer_1_a_curves = ClusterInput()
shrinkage_params = ClusterInput()
stiffness_params = ClusterInput()
layer_1_pts = ClusterInput()
layer_0_pts = ClusterInput()
invert_0_a = ClusterInput()
invert_1_a = ClusterInput()

# ---- group: Get all segments
cluster = Cluster_17(layer_0_pts=layer_0_pts, layer_1_pts=layer_1_pts)  # -> _0_verticals, _0_horizontals, all_segments_on_all_layers, _1_verticals, _1_horizontals

# ---- group: Get segment tree for making angle pairs
cluster_2 = Cluster_18(
    layer_0_verticals=cluster._0_verticals,
    layer_0_horizontals=cluster._0_horizontals,
    layer_1_verticals=cluster._1_verticals,
    layer_1_horizontals=cluster._1_horizontals)

# ---- group: Get relationship trees
cluster_3 = Cluster_15(
    layer_0_pts=layer_0_pts,
    layer_0_a_curves=layer_0_a_curves,
    invert_0_a=invert_0_a,
    layer_1_pts=layer_1_pts,
    layer_1_a_curves=layer_1_a_curves,
    invert_1_a=invert_1_a)  # -> layer_0_rel_tree, layer_1_rel_tree

# ---- group: Get A&B segments
cluster_4 = Cluster_16(
    layer_0_rel_tree=cluster_3.layer_0_rel_tree,
    layer_1_rel_tree=cluster_3.layer_1_rel_tree,
    all_segments_on_all_layers=cluster.all_segments_on_all_layers)  # -> _0_a_vertical, _0_a_horizontal, _1_a_vertical, _1_a_horizontal, _0_b_vertical, _0_b_horizontal, _1_b_vertical, _1_b_horizontal, result_of_weave

# ----
layer_0_rel_tree = ClusterOutput(cluster_3.layer_0_rel_tree)
layer_1_rel_tree = ClusterOutput(cluster_3.layer_1_rel_tree)

cluster_5 = Cluster_19(result_of_weave=cluster_4.result_of_weave)
bang = ExplodeTree(Data=stiffness_params)  # -> Branch0, Branch1, Branch2, Branch3, Branch4, Branch5, Branch6, Branch7
bang_2 = ExplodeTree(Data=shrinkage_params)  # -> Branch0, Branch1, Branch2, Branch3, Branch4, Branch5, Branch6, Branch7
cluster_6 = Cluster_21(
    _0_a_vertical=cluster_4._0_a_vertical,
    _0_a_warp=bang_2.Branch0,
    _0_b_vertical=cluster_4._0_b_vertical,
    _0_b_warp=bang_2.Branch1,
    _0_a_horizontal=cluster_4._0_a_horizontal,
    _0_a_weft=bang_2.Branch2,
    _0_b_horizontal=cluster_4._0_b_horizontal,
    _0_b_weft=bang_2.Branch3,
    _1_a_vertical=cluster_4._1_a_vertical,
    _1_a_warp=bang_2.Branch4,
    _1_b_vertical=cluster_4._1_b_vertical,
    _1_b_warp=bang_2.Branch5,
    _1_a_horizontal=cluster_4._1_a_horizontal,
    _1_a_weft=bang_2.Branch6,
    _1_b_horizontal=cluster_4._1_b_horizontal,
    _1_b_weft=bang_2.Branch7)

# ---- group: Get A&B angle segments
cluster_7 = Cluster_20(segment_tree_for_making_angle_pairs=cluster_2, dispatch_pattern_for_angle_segments=cluster_5)  # -> all_starting_segments, all_ending_segments

# ----
cluster_8 = Cluster_22(
    _0_a_warp=bang.Branch0,
    _0_b_warp=bang.Branch1,
    _0_a_weft=bang.Branch2,
    _0_b_weft=bang.Branch3,
    _1_a_warp=bang.Branch4,
    _1_b_warp=bang.Branch5,
    _1_a_weft=bang.Branch6,
    _1_b_weft=bang.Branch7,
    all_starting_segments=cluster_7.all_starting_segments,
    all_ending_segments=cluster_7.all_ending_segments)

stiffness_goals = ClusterOutput(cluster_8)
shrinkage_goals = ClusterOutput(cluster_6)

# ==== cluster Cluster_25
selection_curve_1 = ClusterInput()
selection_curve_2 = ClusterInput()
selection_curve_3 = ClusterInput()
all_pts_all_layers = ClusterInput()
invert_1 = ClusterInput()
invert_2 = ClusterInput()
invert_3 = ClusterInput()

# ---- group: List all tree item addresses
tstat = TreeStatistics(Tree=all_pts_all_layers)  # -> Paths, Length, Count
dup = DuplicateData(Data=graft(tstat.Paths), Number=graft(tstat.Length), Order=True)  # -> simplify(Data)
series = Series(Start=0, Step=1, Count=tstat.Length)  # -> simplify(Series)
expression = Expression(p=dup, i=series, Expression="Format(\"{0}[{1}]\", p, i)")

# ---- group: Generate path mask from curves
cluster = Cluster_24(all_tree_item_addresses=expression, relay=all_pts_all_layers, selection_curves=selection_curve_1, inverted=invert_1)
cluster_2 = Cluster_24(all_tree_item_addresses=expression, relay=all_pts_all_layers, selection_curves=selection_curve_2, inverted=invert_2)
cluster_3 = Cluster_24(all_tree_item_addresses=expression, relay=all_pts_all_layers, selection_curves=selection_curve_3, inverted=invert_3)

# ----
set_1 = ClusterOutput(cluster)
set_3 = ClusterOutput(cluster_3)
set_2 = ClusterOutput(cluster_2)

# ==== cluster Cluster_26
show_color_palette = ClusterInput()
all_colors = ClusterInput()
extent_x = ClusterInput()
extent_y = ClusterInput()

dispatch = Dispatch(List=all_colors, DispatchPattern=show_color_palette)  # -> ListA, ListB
dispatch_2 = Dispatch(List=extent_y, DispatchPattern=show_color_palette)  # -> ListA, ListB
bang = ExplodeTree(Data=simplify(dispatch.ListA))  # -> Branch0, Branch1, Branch2, Branch3, Branch4, Branch5
swatch = ColourSwatch(SwatchColor=RGBA(255, 255, 255, 0))
swatch_2 = ColourSwatch(SwatchColor=RGBA(255, 255, 255, 0))
swatch_3 = ColourSwatch(SwatchColor=RGBA(255, 255, 255, 0))

panel = Panel("""With
 join""")
panel_2 = Panel("""Without
   join""")
relay = Relay([panel, panel_2])

# ---- group: Color component from layer 0
entwine = Entwine(
    Branch00=bang.Branch0,
    Branch01=bang.Branch1,
    Branch02=bang.Branch0,
    Branch03=bang.Branch1,
    Branch04=bang.Branch0,
    Branch05=bang.Branch1,
    Branch06=bang.Branch0,
    Branch07=bang.Branch1,
    Branch08=bang.Branch0,
    Branch09=bang.Branch1,
    FlattenInputs=True)  # -> simplify(Result)

# ---- group: Color component from exchanges
entwine_2 = Entwine(
    Branch00=swatch_3,
    Branch01=swatch_3,
    Branch02=swatch_3,
    Branch03=swatch_3,
    Branch04=swatch_3,
    Branch05=swatch_3,
    Branch06=bang.Branch4,
    Branch07=bang.Branch4,
    Branch08=bang.Branch4,
    Branch09=bang.Branch4,
    FlattenInputs=True)  # -> simplify(Result)

# ---- group: Color component from layer 1
entwine_3 = Entwine(
    Branch00=swatch_2,
    Branch01=swatch_2,
    Branch02=bang.Branch2,
    Branch03=bang.Branch2,
    Branch04=bang.Branch3,
    Branch05=bang.Branch3,
    Branch06=bang.Branch2,
    Branch07=bang.Branch2,
    Branch08=bang.Branch3,
    Branch09=bang.Branch3,
    FlattenInputs=True)  # -> simplify(Result)

# ---- group: Color component from joins
entwine_4 = Entwine(
    Branch00=swatch,
    Branch01=swatch,
    Branch02=bang.Branch5,
    Branch03=bang.Branch5,
    Branch04=bang.Branch5,
    Branch05=bang.Branch5,
    Branch06=bang.Branch5,
    Branch07=bang.Branch5,
    Branch08=bang.Branch5,
    Branch09=bang.Branch5,
    FlattenInputs=True)  # -> simplify(Result)

# ---- group: Match color tree structure to swatch tree
entwine_5 = Entwine(Branch00=entwine, Branch01=entwine_3, Branch02=entwine_2, FlattenInputs=True)
entwine_6 = Entwine(Branch00=entwine, Branch01=entwine_3, Branch02=entwine_2, Branch03=entwine_4, FlattenInputs=True)
merge = Merge(Data1=entwine_5, Data2=entwine_6)
flip = FlipMatrix(Data=merge)
clean = CleanTree(RemoveNulls=True, RemoveInvalid=True, RemoveEmpty=True, Tree=flip)  # -> simplify(Tree)

# ----
colors = ClusterOutput(clean)
label_2_text = ClusterOutput(relay)

# ---- group: Make 2 columns of swatches
expression = Expression(y=dispatch_2.ListA, Expression="floor((y-9)/10)")
expression_2 = Expression(y=dispatch_2.ListA, a=expression, Expression="floor((y-10*a)/9)+a")
expression_3 = Expression(y=dispatch_2.ListA, b=expression, Expression="y-b")
expression_4 = Expression(x=extent_x, a=expression, b=expression_2, Expression="x+b-a")
expression_5 = Expression(c=expression_4, a=expression, Expression="c+a")
series = Series(Start=dispatch_2.ListA, Step=expr("-x", expression_2), Count=10)
series_2 = Series(Start=expression_3, Step=expr("-x", expression_2), Count=10)
expression_6 = Expression(x=series, y=series_2, Expression="Format(\"{0} to {1}\", x, y)")
expression_7 = Expression(x=expression_4, y=expression_5, Expression="Format(\"{0} to {1}\", x, y)")
panel_3 = Panel("""{0}
{1}""")
entwine_7 = Entwine(FlattenInputs=True)  # -> graft(Result)

# ----
expression_8 = Expression(x=expression_4, y=expression_5, b=expression_2, Expression="Format(\"{0} to {1}\", x+b, y+b)")
expression_9 = Expression(d=expression_5, a=expression, b=expression_2, Expression="d+b-a/2")
expression_10 = Expression(x=extent_x, a=expression, b=expression_2, Expression="x+b-a/2")
expression_11 = Expression(y=dispatch_2.ListA, a=expression, b=expression_2, Expression="y+b-a/2")

# ---- group: Labels
expression_12 = Expression(x=series, y=series_2, Expression="(x+y)/2")
expression_13 = Expression(a=expression, b=expression_2, d=expression_5, Expression="a/2+b+d")
panel_4 = Panel("""0-A (single layer)
0-B (single layer)
1-A over 0-A
1-A over 0-B
1-B over 0-A
1-B over 0-B
0-A over 1-A
0-B over 1-A
0-A over 1-B
0-B over 1-B""")
pt = ConstructPoint(XCoordinate=expression_13, YCoordinate=expression_12, ZCoordinate=0)

# ----
pt_2 = ConstructPoint(XCoordinate=[expression_10, expression_9], YCoordinate=expression_11, ZCoordinate=0)

# ---- group: Make 2 columns of swatches (continued)
rectangle = Rectangle(Plane=PlaneXY(0, 0, 0), XSize=graft([expression_7, expression_8]), YSize=expression_6, Radius=0)  # -> simplify(flatten(Rectangle)), Length
split = SplitTree(Data=simplify(graft(rectangle.Rectangle)), Masks=flatten(panel_3))  # -> Positive, Negative
merge_2 = Merge(Data1=split.Negative, Data2=simplify(entwine_7))

# ----
swatches = ClusterOutput(merge_2)
label_1_text = ClusterOutput(panel_4)
label_1_locations = ClusterOutput(pt)
label_2_locations = ClusterOutput(pt_2)

# ==== cluster Cluster_29
exchange_curves_inverted = ClusterInput()
filter_join_curves_inverted = ClusterInput()
join_curves_inverted = ClusterInput()
show_color_mapping = ClusterInput()
filter_join_curves = ClusterInput()
join_curves = ClusterInput()
layer_0_a_curves = ClusterInput()
layer_1_a_curves = ClusterInput()
exchange_curves = ClusterInput()
relay = ClusterInput()
_0_a_inverted = ClusterInput()
_1_a_inverted = ClusterInput()
extent_x = ClusterInput()
extent_y = ClusterInput()

# ---- group: Don't shade Layer 1 regions if there are no join/exchange regions (design is assumed to be single layer) / Are exchange curves null?
item = ListItem(List=exchange_curves, Index=0, Wrap=True)
null = NullItem(Item=item)  # -> NullFlags, InvalidFlags, Description
not = GateNot(A=exchange_curves_inverted)
and = GateAnd(A=null.NullFlags, B=not)

# ---- group: Don't shade Layer 1 regions if there are no join/exchange regions (design is assumed to be single layer) / Are join curves null?
item_2 = ListItem(List=join_curves, Index=0, Wrap=True)
null_2 = NullItem(Item=item_2)  # -> NullFlags, InvalidFlags, Description
not_2 = GateNot(A=join_curves_inverted)
and_2 = GateAnd(A=null_2.NullFlags, B=not_2)

# ---- group: Don't shade Layer 1 regions if there are no join/exchange regions (design is assumed to be single layer) / Are join & filter curves null?
item_3 = ListItem(List=filter_join_curves, Index=0, Wrap=True)
null_3 = NullItem(Item=item_3)  # -> NullFlags, InvalidFlags, Description
not_3 = GateNot(A=filter_join_curves_inverted)
and_3 = GateAnd(A=null_3.NullFlags, B=not_3)

# ---- group: Don't shade Layer 1 regions if there are no join/exchange regions (design is assumed to be single layer)
and_4 = GateAnd(A=and, B=and_2)
and_5 = GateAnd(A=and_4, B=and_3)
not_4 = GateNot(A=and_5)

# ---- group: Assign color to fill regions
join = Slider(0, range=0..1)
number_slider = Slider(0.1, range=0..1)
number_slider_2 = Slider(0.4, range=0..1)
number_slider_3 = Slider(0.8, range=0..1)
exchange = Slider(0.1, range=0..1)
number_slider_4 = Slider(0.6, range=0..1)
entwine = Entwine(
    Branch00=number_slider,
    Branch01=number_slider_4,
    Branch02=number_slider_2,
    Branch03=number_slider_3,
    Branch04=exchange,
    Branch05=join,
    FlattenInputs=True)
hsl = ColourHSL(
    Alpha=graft([0.4, 0.4, 0.4, 0.4, 0.4, 0.5]),
    Hue=entwine,
    Saturation=graft([0.9, 0.9, 0.9, 0.9, 0.9, 0]),
    Luminance=graft([0.6, 0.6, 0.6, 0.6, 0.6, 1]))  # -> graft(Colour)

# ----
all_colors = ClusterOutput(hsl)

# ---- group: Generate fill regions
dispatch = Dispatch(List=extent_x, DispatchPattern=show_color_mapping)  # -> ListA, ListB

# ---- group: Generate fill regions / Bounding rectangle
dom = ConstructDomain(DomainStart=0, DomainEnd=dispatch.ListA)
dom_2 = ConstructDomain(DomainStart=0, DomainEnd=extent_y)
rectangle = Rectangle(Plane=PlaneXY(0, 0, 0), XSize=dom, YSize=dom_2, Radius=0)  # -> Rectangle, Length

# ---- group: Generate fill regions (continued)
cluster = Cluster_28(
    join_curves=join_curves,
    bounding_rectangle=rectangle.Rectangle,
    join_curves_inverted=join_curves_inverted,
    tree_of_filtered_joined_pts=relay,
    show_color_mapping=show_color_mapping)
cluster_2 = Cluster_27(curves=exchange_curves, bounding_rectangle=rectangle.Rectangle, inverted=exchange_curves_inverted)  # -> a_fills, b_fills
cluster_3 = Cluster_27(curves=layer_1_a_curves, bounding_rectangle=rectangle.Rectangle, inverted=_1_a_inverted)  # -> a_fills, b_fills
cluster_4 = Cluster_27(curves=layer_0_a_curves, bounding_rectangle=rectangle.Rectangle, inverted=_0_a_inverted)  # -> a_fills, b_fills

# ----
dispatch_2 = Dispatch(List=cluster_3.a_fills, DispatchPattern=not_4)  # -> ListA, ListB
dispatch_3 = Dispatch(List=cluster_3.b_fills, DispatchPattern=not_4)  # -> ListA, ListB

# ---- group: Generate fill regions (continued)
entwine_2 = Entwine(
    Branch00=cluster_4.a_fills,
    Branch01=cluster_4.b_fills,
    Branch02=dispatch_2.ListA,
    Branch03=dispatch_3.ListA,
    Branch04=cluster_2.a_fills,
    Branch05=cluster,
    FlattenInputs=True)

# ----
all_fills = ClusterOutput(entwine_2)

# ==== cluster Cluster_41
join_at_edges = ClusterInput()
pts_to_filter_and_join = ClusterInput()
all_points_on_all_layers = ClusterInput()
pts_to_join = ClusterInput()
extent_y = ClusterInput()
extent_x = ClusterInput()
pts_to_swap = ClusterInput()
filter = ClusterInput()

# ---- group: Find normal vector for each pt on layer 0
cluster = Cluster_30(extent_x=extent_x, extent_y=extent_y, all_points_on_all_layers=all_points_on_all_layers)

# ----
cluster_2 = Cluster_38(extent_x=extent_x, extent_y=extent_y)
dispatch = Dispatch(List=cluster_2, DispatchPattern=join_at_edges)  # -> ListA, ListB

cluster_3 = Cluster_40(
    all_points_on_all_layers=all_points_on_all_layers,
    pts_to_join_border_pts=pts_to_join,
    border_join_mask=dispatch.ListA,
    filter=filter,
    pts_to_filter_and_join=pts_to_filter_and_join)  # -> layer_0_join_pts, layer_1_join_pts, tree_of_filtered_joined_pts
cluster_4 = Cluster_39(all_points_on_all_layers=all_points_on_all_layers, pts_to_swap=pts_to_swap)  # -> all_points_on_all_layers_after_swaps, all_swap_pts
cluster_5 = Cluster_31(layer_0_join_pts=cluster_3.layer_0_join_pts, layer_1_join_pts=cluster_3.layer_1_join_pts)

# ---- group: Create columns
cluster_6 = Cluster_35(all_points_on_all_layers_after_swaps=cluster_4.all_points_on_all_layers_after_swaps)  # -> lower_column_pts, lower_plane, column_bottoms, column_middles, column_tops, upper_column_pts, upper_plane

# ----
cluster_7 = Cluster_37(column_middles=cluster_6.column_middles, normal_vectors_for_layer_0_pts=cluster)
cluster_8 = Cluster_36(column_middles=cluster_6.column_middles)
cluster_9 = Cluster_33(
    lower_column_pts=cluster_6.lower_plane,
    lower_plane=cluster_6.lower_column_pts,
    upper_column_pts=cluster_6.upper_column_pts,
    upper_plane=cluster_6.upper_plane)
cluster_10 = Cluster_32(column_tops=cluster_6.column_tops, column_bottoms=cluster_6.column_bottoms)
cluster_11 = Cluster_34(column_bottoms=cluster_6.column_bottoms, column_middles=cluster_6.column_middles, column_tops=cluster_6.column_tops)

# ---- group: Placeholder point in case of empty set
pt = ConstructPoint(XCoordinate="1000", YCoordinate="1000", ZCoordinate="1000")

# ---- group: Joining & layer separation goals
entwine = Entwine(Branch00=cluster_5, Branch01=cluster_8, Branch02=cluster_7, FlattenInputs=True)

# ---- group: Column goals
entwine_2 = Entwine(Branch00=cluster_9, Branch01=cluster_10, Branch02=cluster_11, FlattenInputs=True)

# ---- group: Show join pts
show = Show(G=[cluster_3.layer_0_join_pts, cluster_3.layer_1_join_pts, pt])

# ---- group: Show swap pts
show_2 = Show(G=[cluster_4.all_swap_pts, pt])

# ---- group: Show layer separation lines
show_3 = Show(G=cluster_6.column_middles)

# ----
column_goals = ClusterOutput(entwine_2)
show_join_pts = ClusterOutput(show)
show_swap_pts = ClusterOutput(show_2)
show_layer_separation_lines = ClusterOutput(show_3)
tree_of_filtered_joined_pts = ClusterOutput(cluster_3.tree_of_filtered_joined_pts)
joining_layer_separation_goals = ClusterOutput(entwine)

# ==== cluster Cluster
all_cells_on_all_layers = ClusterInput()

explode = Explode(Curve=all_cells_on_all_layers, Recursive=True)  # -> Segments, Vertices
pshift = ShiftPaths(Data=explode.Segments, Offset=-2)
flip = FlipMatrix(Data=pshift)

# ---- group: Show lines
show = Show(G=flip)

# ----
show_lines = ClusterOutput(show)

# ==== cluster Cluster_2
layer_0_rel_tree = ClusterInput()
layer_0_pts = ClusterInput()

# ---- group: Dummy point
pt = ConstructPoint(XCoordinate="1000", YCoordinate="1000", ZCoordinate="1000")

# ----
expression = Expression(x=layer_0_rel_tree, Expression="x/2")
dispatch = Dispatch(List=layer_0_pts, DispatchPattern=expression)  # -> ListA, ListB
clean = CleanTree(RemoveNulls=True, RemoveInvalid=True, RemoveEmpty=True, Tree=dispatch.ListA)
show = Show(G=[clean, pt])

show_0_a_pts = ClusterOutput(show)

# ==== cluster Cluster_3
layer_1_rel_tree = ClusterInput()
layer_1_pts = ClusterInput()

# ---- group: Dummy point
pt = ConstructPoint(XCoordinate="1000", YCoordinate="1000", ZCoordinate="1000")

# ----
expression = Expression(x=layer_1_rel_tree, Expression="x/2")
dispatch = Dispatch(List=layer_1_pts, DispatchPattern=expression)  # -> ListA, ListB
clean = CleanTree(RemoveNulls=True, RemoveInvalid=True, RemoveEmpty=True, Tree=dispatch.ListA)
show = Show(G=[clean, pt])

show_1_a_pts = ClusterOutput(show)

# ==== cluster Cluster_4
all_points_on_all_layers = ClusterInput()

# ---- group: Plastic anchor to prevent drift
plasticanchor = PlasticAnchor(Point=all_points_on_all_layers, Limit=Slider(0.5, range=0..1), Strength=Slider(0.2, range=0..1), Reset=False)

# ----
plastic_anchor_goal = ClusterOutput(plasticanchor)

# ==== cluster Cluster_5

# ---- group: Floor
floor = Floor(Strength=Slider(11, range=0..100))

# ----
floor_goal = ClusterOutput(floor)

# ==== cluster Cluster_6

# ---- group: Grab
grab = Grab(On=True, Strength=Slider(100, range=0..1000), Range=3)

# ----
grab_goal = ClusterOutput(grab)

# ==== cluster Cluster_7
all_points_on_all_layers = ClusterInput()

# ---- group: Load
neg = Negative(Value=Slider(0.011, range=0..1))
Z = UnitZ(Factor=neg)
load = Load(Point=all_points_on_all_layers, ForceVector=Z, Weighting=1)  # disabled

# ----
unary_load_goal = ClusterOutput(load)

# ==== cluster Cluster_8
all_points_on_all_layers = ClusterInput()

pshift = ShiftPaths(Data=all_points_on_all_layers, Offset=-1)
flip = FlipMatrix(Data=pshift)
show = Show(G=flip)

show_pts = ClusterOutput(show)

# ==== cluster GetPointAndCellTree
extent_y = ClusterInput()
layer_0_pts = ClusterInput()
layer_1_pts = ClusterInput()
layer_0_cells = ClusterInput()
layer_1_cells = ClusterInput()

entwine = Entwine(Branch00=layer_0_pts, Branch01=layer_1_pts, FlattenInputs=True)
entwine_2 = Entwine(Branch00=layer_0_cells, Branch01=layer_1_cells, FlattenInputs=True)
partition = PartitionList(List=entwine_2, Size=extent_y)  # -> simplify(Chunks)
expression = Expression(y=extent_y, Expression="y+1")
partition_2 = PartitionList(List=entwine, Size=expression)  # -> simplify(Chunks)

all_cells_on_all_layers = ClusterOutput(partition)
all_points_on_all_layers = ClusterOutput(partition_2)

# ==== cluster Cluster_10
X = ClusterInput()
Y = ClusterInput()

z_offset = Panel("{0,0,2}")
xy = XYPlane(Origin=z_offset)

# ---- group: Layer 0
recgrid = Rectangular(Plane=PlaneXY(0, 0, 0), SizeX=1, SizeY=1, ExtentX=X, ExtentY=Y)  # -> simplify(Cells), simplify(Points)

# ---- group: Layer 1
recgrid_2 = Rectangular(Plane=xy, SizeX=1, SizeY=1, ExtentX=X, ExtentY=Y)  # -> simplify(Cells), simplify(Points)

# ----
layer_0_pts = ClusterOutput(recgrid.Points)
layer_1_pts = ClusterOutput(recgrid_2.Points)
layer_1_cells = ClusterOutput(recgrid_2.Cells)
layer_0_cells = ClusterOutput(recgrid.Cells)

# ==== cluster Cluster_13
offset = ClusterInput()
exchange_pts = ClusterInput()
join_pts = ClusterInput()
_0_a_pts = ClusterInput()
_1_a_pts = ClusterInput()

# ---- group: Join pts
amp = Amplitude(Vector=".1,.1,0", Amplitude=offset)
move = Move(Geometry=join_pts, Motion=amp)  # -> Geometry, Transform

# ---- group: Exchange pts
amp_2 = Amplitude(Vector="-.1,-.1,0", Amplitude=offset)
move_2 = Move(Geometry=exchange_pts, Motion=amp_2)  # -> Geometry, Transform

# ---- group: 0-A pts
amp_3 = Amplitude(Vector="-.1,.1,0", Amplitude=offset)
move_3 = Move(Geometry=_0_a_pts, Motion=amp_3)  # -> Geometry, Transform

# ---- group: 1-A pts
amp_4 = Amplitude(Vector=".1,-.1,0", Amplitude=offset)
move_4 = Move(Geometry=_1_a_pts, Motion=amp_4)  # -> Geometry, Transform

# ----
join_pts_2 = ClusterOutput(move.Geometry)
_0_a_pts_2 = ClusterOutput(move_3.Geometry)
_1_a_pts_2 = ClusterOutput(move_4.Geometry)
exchange_pts_2 = ClusterOutput(move_2.Geometry)

# ==== cluster Cluster_15
layer_1_a_curves = ClusterInput()
layer_0_a_curves = ClusterInput()
layer_0_pts = ClusterInput()
invert_1_a = ClusterInput()
layer_1_pts = ClusterInput()
invert_0_a = ClusterInput()

# ---- group: Placeholder curve
circle = CircleCNR(Center="{-5,-5,0}", Normal=Vector(0, 0, 1), Radius=1)

# ----
merge = Merge(Data1=layer_0_a_curves, Data2=circle)
merge_2 = Merge(Data1=layer_1_a_curves, Data2=circle)

# ---- group: Get pt/curve relationship trees (2)
incurves = PointInCurves(Point=layer_0_pts, Curves=merge)  # -> Relationship, Index, Point
incurves_2 = PointInCurves(Point=layer_1_pts, Curves=merge_2)  # -> Relationship, Index, Point

# ---- group: Get pt/curve relationship trees (2) / Enable inverting
equals = Equality(FirstNumber=incurves.Relationship, SecondNumber="0")  # -> Equality, Inequality
xnor = GateXnor(A=invert_0_a, B=equals.Equality)
expression = Expression(a=xnor, Expression="if(a=True, 2, 0)")

equals_2 = Equality(FirstNumber=incurves_2.Relationship, SecondNumber="0")  # -> Equality, Inequality
xnor_2 = GateXnor(A=invert_1_a, B=equals_2.Equality)
expression_2 = Expression(a=xnor_2, Expression="if(a=True, 2, 0)")

# ----
layer_1_rel_tree = ClusterOutput(expression_2)
layer_0_rel_tree = ClusterOutput(expression)

# ==== cluster Cluster_16
layer_0_rel_tree = ClusterInput()
layer_1_rel_tree = ClusterInput()
all_segments_on_all_layers = ClusterInput()

# ---- group: Get A&B segments
weave = Weave(Pattern=[0, 1], Stream0=layer_0_rel_tree, Stream1=layer_1_rel_tree, NullGaps=False)
relitem = RelativeItem(Tree=weave, Offset="{0}[2]", WrapPaths=True, WrapItems=False)  # -> ItemA, ItemB
relitem_2 = RelativeItem(Tree=weave, Offset="{1}[0]", WrapPaths=False, WrapItems=True)  # -> ItemA, ItemB
dispatch = Dispatch(List=relitem.ItemA, DispatchPattern=[True, False])  # -> ListA, ListB
dispatch_2 = Dispatch(List=relitem.ItemB, DispatchPattern=[True, False])  # -> ListA, ListB
dispatch_3 = Dispatch(List=relitem_2.ItemA, DispatchPattern=[True, False])  # -> ListA, ListB
dispatch_4 = Dispatch(List=relitem_2.ItemB, DispatchPattern=[True, False])  # -> ListA, ListB
entwine = Entwine(
    Branch00=dispatch_2.ListA,
    Branch01=dispatch_4.ListA,
    Branch02=dispatch_2.ListB,
    Branch03=dispatch_4.ListB,
    FlattenInputs=True)
entwine_2 = Entwine(
    Branch00=dispatch.ListA,
    Branch01=dispatch_3.ListA,
    Branch02=dispatch.ListB,
    Branch03=dispatch_3.ListB,
    FlattenInputs=True)
expression = Expression(a=entwine_2, b=entwine, Expression="floor((a+b)/4)")
dispatch_5 = Dispatch(List=all_segments_on_all_layers, DispatchPattern=expression)  # -> ListA, ListB

# ----
bang = ExplodeTree(Data=dispatch_5.ListA)  # -> Branch0, Branch1, Branch2, Branch3
bang_2 = ExplodeTree(Data=dispatch_5.ListB)  # -> Branch0, Branch1, Branch2, Branch3
_1_a_vertical = ClusterOutput(bang.Branch2)
_1_b_vertical = ClusterOutput(bang_2.Branch2)
_0_a_vertical = ClusterOutput(bang.Branch0)
_0_b_vertical = ClusterOutput(bang_2.Branch0)
_1_a_horizontal = ClusterOutput(bang.Branch3)
_1_b_horizontal = ClusterOutput(bang_2.Branch3)
_0_a_horizontal = ClusterOutput(bang.Branch1)
_0_b_horizontal = ClusterOutput(bang_2.Branch1)
result_of_weave = ClusterOutput(weave)

# ==== cluster Cluster_17
layer_1_pts = ClusterInput()
layer_0_pts = ClusterInput()

# ---- group: Get segments
relitem = RelativeItem(Tree=layer_0_pts, Offset="{0}[1]", WrapPaths=False, WrapItems=False)  # -> ItemA, ItemB
relitem_2 = RelativeItem(Tree=layer_0_pts, Offset="{1}[0]", WrapPaths=False, WrapItems=False)  # -> ItemA, ItemB

relitem_3 = RelativeItem(Tree=layer_1_pts, Offset="{0}[1]", WrapPaths=False, WrapItems=False)  # -> ItemA, ItemB
relitem_4 = RelativeItem(Tree=layer_1_pts, Offset="{1}[0]", WrapPaths=False, WrapItems=False)  # -> ItemA, ItemB

# ---- group: Get segments / 0 - verticals
ln = Line(StartPoint=relitem.ItemA, EndPoint=relitem.ItemB)

# ---- group: Get segments / 0 - horizontals
ln_2 = Line(StartPoint=relitem_2.ItemA, EndPoint=relitem_2.ItemB)

# ---- group: Get segments / 1 - horizontals
ln_3 = Line(StartPoint=relitem_4.ItemA, EndPoint=relitem_4.ItemB)

# ---- group: Get segments / 1 - verticals
ln_4 = Line(StartPoint=relitem_3.ItemA, EndPoint=relitem_3.ItemB)

# ---- group: Get segments / All segments on all layers
entwine = Entwine(Branch00=ln, Branch01=ln_2, Branch02=ln_4, Branch03=ln_3, FlattenInputs=True)

# ----
_0_verticals = ClusterOutput(ln)
_1_verticals = ClusterOutput(ln_4)
_0_horizontals = ClusterOutput(ln_2)
_1_horizontals = ClusterOutput(ln_3)
all_segments_on_all_layers = ClusterOutput(entwine)

# ==== cluster Cluster_18
layer_1_horizontals = ClusterInput()
layer_0_horizontals = ClusterInput()
layer_0_verticals = ClusterInput()
layer_1_verticals = ClusterInput()

# ---- group: Layer 1 segments - shifted
relitem = RelativeItem(Tree=layer_1_horizontals, Offset="{1}[0]", WrapPaths=False, WrapItems=False)  # -> ItemA, ItemB
relitem_2 = RelativeItem(Tree=layer_1_verticals, Offset="{0}[1]", WrapPaths=False, WrapItems=False)  # -> ItemA, ItemB

# ---- group: Layer 0 segments - shifted
relitem_3 = RelativeItem(Tree=layer_0_verticals, Offset="{0}[1]", WrapPaths=False, WrapItems=False)  # -> ItemA, ItemB
relitem_4 = RelativeItem(Tree=layer_0_horizontals, Offset="{1}[0]", WrapPaths=False, WrapItems=False)  # -> ItemA, ItemB

# ----
entwine = Entwine(
    Branch00=relitem_3.ItemA,
    Branch01=relitem_4.ItemA,
    Branch02=relitem_2.ItemA,
    Branch03=relitem.ItemA,
    Branch04=relitem_3.ItemB,
    Branch05=relitem_4.ItemB,
    Branch06=relitem_2.ItemB,
    Branch07=relitem.ItemB,
    FlattenInputs=True)

segment_tree_for_making_angle_pairs = ClusterOutput(entwine)

# ==== cluster Cluster_19
result_of_weave = ClusterInput()

# ---- group: Dispatch pattern for angle segments
relitem = RelativeItem(Tree=result_of_weave, Offset="{0}[-2]", WrapPaths=False, WrapItems=False)  # -> ItemA, ItemB
relitem_2 = RelativeItem(Tree=result_of_weave, Offset="{-1}[0]", WrapPaths=False, WrapItems=False)  # -> ItemA, ItemB
relitem_3 = RelativeItem(Tree=relitem_2.ItemA, Offset="{1}[0]", WrapPaths=False, WrapItems=False)  # -> ItemA, ItemB
relitem_4 = RelativeItem(Tree=relitem.ItemA, Offset="{0}[2]", WrapPaths=False, WrapItems=False)  # -> ItemA, ItemB
dispatch = Dispatch(List=relitem_4.ItemA, DispatchPattern=[True, False])  # -> ListA, ListB
dispatch_2 = Dispatch(List=relitem_3.ItemA, DispatchPattern=[True, False])  # -> ListA, ListB
entwine = Entwine(
    Branch00=dispatch.ListA,
    Branch01=dispatch_2.ListA,
    Branch02=dispatch.ListB,
    Branch03=dispatch_2.ListB,
    FlattenInputs=True)
expression = Expression(a=entwine, Expression="if(a>1, True, False)")
path_mapper = PathMapper(expression, source=["{0;A}", "{0;A}"], target=["{0;A}", "{0;(A+path_count)}"])

# ----
dispatch_pattern_for_angle_segments = ClusterOutput(path_mapper)

# ==== cluster Cluster_20
segment_tree_for_making_angle_pairs = ClusterInput()
dispatch_pattern_for_angle_segments = ClusterInput()

dispatch = Dispatch(List=segment_tree_for_making_angle_pairs, DispatchPattern=dispatch_pattern_for_angle_segments)  # -> ListA, ListB

bang = ExplodeTree(Data=dispatch.ListA)  # -> Branch0, Branch1, Branch2, Branch3, Branch4, Branch5, Branch6, Branch7
bang_2 = ExplodeTree(Data=dispatch.ListB)  # -> Branch0, Branch1, Branch2, Branch3, Branch4, Branch5, Branch6, Branch7

# ---- group: end
entwine = Entwine(
    Branch00=bang.Branch4,
    Branch01=bang_2.Branch4,
    Branch02=bang.Branch5,
    Branch03=bang_2.Branch5,
    Branch04=bang.Branch6,
    Branch05=bang_2.Branch6,
    Branch06=bang.Branch7,
    Branch07=bang_2.Branch7,
    FlattenInputs=True)

# ---- group: start
entwine_2 = Entwine(
    Branch00=bang.Branch0,
    Branch01=bang_2.Branch0,
    Branch02=bang.Branch1,
    Branch03=bang_2.Branch1,
    Branch04=bang.Branch2,
    Branch05=bang_2.Branch2,
    Branch06=bang.Branch3,
    Branch07=bang_2.Branch3,
    FlattenInputs=True)

# ----
all_ending_segments = ClusterOutput(entwine)
all_starting_segments = ClusterOutput(entwine_2)

# ==== cluster Cluster_21
_0_a_vertical = ClusterInput()
_0_a_warp = ClusterInput()
_0_b_vertical = ClusterInput()
_0_b_warp = ClusterInput()
_0_a_horizontal = ClusterInput()
_0_a_weft = ClusterInput()
_0_b_horizontal = ClusterInput()
_0_b_weft = ClusterInput()
_1_a_vertical = ClusterInput()
_1_a_warp = ClusterInput()
_1_b_vertical = ClusterInput()
_1_b_warp = ClusterInput()
_1_a_horizontal = ClusterInput()
_1_a_weft = ClusterInput()
_1_b_horizontal = ClusterInput()
_1_b_weft = ClusterInput()

# ---- group: Shrinkage goals
len = Length(Curve=_0_a_vertical)
expression = Expression(a=len, b=_0_a_warp, Expression="a*b")

len_2 = Length(Curve=_0_b_vertical)
expression_2 = Expression(a=len_2, b=_0_b_warp, Expression="a*b")

len_3 = Length(Curve=_0_a_horizontal)
expression_3 = Expression(a=len_3, b=_0_a_weft, Expression="a*b")

len_4 = Length(Curve=_0_b_horizontal)
expression_4 = Expression(a=len_4, b=_0_b_weft, Expression="a*b")

len_5 = Length(Curve=_1_a_vertical)
expression_5 = Expression(a=len_5, b=_1_a_warp, Expression="a*b")

len_6 = Length(Curve=_1_b_vertical)
expression_6 = Expression(a=len_6, b=_1_b_warp, Expression="a*b")

len_7 = Length(Curve=_1_a_horizontal)
expression_7 = Expression(a=len_7, b=_1_a_weft, Expression="a*b")

len_8 = Length(Curve=_1_b_horizontal)
expression_8 = Expression(a=len_8, b=_1_b_weft, Expression="a*b")

# ---- group: Shrinkage goals / Line
entwine = Entwine(
    Branch00=_0_a_vertical,
    Branch01=_0_b_vertical,
    Branch02=_0_a_horizontal,
    Branch03=_0_b_horizontal,
    Branch04=_1_a_vertical,
    Branch05=_1_b_vertical,
    Branch06=_1_a_horizontal,
    Branch07=_1_b_horizontal,
    FlattenInputs=True)  # -> simplify(Result)

# ---- group: Shrinkage goals / Length
entwine_2 = Entwine(
    Branch00=expression,
    Branch01=expression_2,
    Branch02=expression_3,
    Branch03=expression_4,
    Branch04=expression_5,
    Branch05=expression_6,
    Branch06=expression_7,
    Branch07=expression_8,
    FlattenInputs=True)  # -> simplify(Result)

# ----
clean = CleanTree(RemoveNulls=True, RemoveInvalid=True, RemoveEmpty=True, Tree=entwine)
clean_2 = CleanTree(RemoveNulls=True, RemoveInvalid=True, RemoveEmpty=True, Tree=entwine_2)

# ---- group: Shrinkage goals
length_line = LengthLine(Line=clean, Length=clean_2, Strength=Slider(100, range=0..180))

# ----
shrinkage_goals = ClusterOutput(length_line)

# ==== cluster Cluster_22
all_starting_segments = ClusterInput()
all_ending_segments = ClusterInput()
_0_a_warp = ClusterInput()
_0_b_warp = ClusterInput()
_0_a_weft = ClusterInput()
_0_b_weft = ClusterInput()
_1_a_warp = ClusterInput()
_1_b_warp = ClusterInput()
_1_a_weft = ClusterInput()
_1_b_weft = ClusterInput()

# ---- group: Stiffness goals / Bug fix - Restore empty branches to cleaned cluster input
entwine = Entwine(FlattenInputs=True)
merge = Merge(Data1=all_starting_segments, Data2=entwine)

# ---- group: Stiffness goals
entwine_2 = Entwine(
    Branch00=_0_a_warp,
    Branch01=_0_b_warp,
    Branch02=_0_a_weft,
    Branch03=_0_b_weft,
    Branch04=_1_a_warp,
    Branch05=_1_b_warp,
    Branch06=_1_a_weft,
    Branch07=_1_b_weft,
    FlattenInputs=True)
tstat = TreeStatistics(Tree=merge)  # -> Paths, Length, Count
stack = StackData(Data=entwine_2, Stack=graft(tstat.Length))  # -> simplify(Data)
clean = CleanTree(RemoveNulls=True, RemoveInvalid=True, RemoveEmpty=True, Tree=all_starting_segments)
clean_2 = CleanTree(RemoveNulls=True, RemoveInvalid=True, RemoveEmpty=True, Tree=all_ending_segments)
clean_3 = CleanTree(RemoveNulls=True, RemoveInvalid=True, RemoveEmpty=True, Tree=stack)
expression = Expression(x=clean_3, Expression="abs(1-x)*π")
clampangle = ClampAngle(
    LineA=simplify(clean),
    LineB=simplify(clean_2),
    UpperLimit=simplify(expression),
    LowerLimit="0",
    Strength=Slider(200, range=0..2000))

# ----
stiffness_goals = ClusterOutput(clampangle)

# ==== cluster Cluster_24
all_tree_item_addresses = ClusterInput()
selection_curves = ClusterInput()
relay = ClusterInput()
inverted = ClusterInput()

# ---- group: Path mask based on curves
panel = Panel("{-5,-5,0}")
not = GateNot(A=inverted)

# ---- group: Path mask based on curves / Placeholder curve
circle = CircleCNR(Center=panel, Normal=Vector(0, 0, 1), Radius=1)

# ---- group: Path mask based on curves (continued)
incurves = PointInCurves(Point=relay, Curves=[circle, selection_curves])  # -> Relationship, Index, Point
expression = Expression(a=incurves.Relationship, b=inverted, c=not, Expression="if(a≥1, c, b)")
dispatch = Dispatch(List=all_tree_item_addresses, DispatchPattern=expression)  # -> ListA, ListB

# ----
set = ClusterOutput(dispatch.ListA)

# ==== cluster Cluster_27
bounding_rectangle = ClusterInput()
curves = ClusterInput()
inverted = ClusterInput()

# ---- group: Generate fill regions - debugged inverted curve output by subtracting Brep union (instead of flattened curve list) from bounding rect
circle = CircleCNR(Center=Point(-5, -5, 0), Normal=Vector(0, 0, 1), Radius=1)
boundary = BoundarySurfaces(Edges=[curves, circle])
fmerge = MergeFaces(Brep=boundary)  # -> Breps, Before, After
runion = RegionUnion(Curves=[curves, circle])
expression = Expression(a=inverted, Expression="Format(\"{{{0}}}\", if (a=False, 0, 1))")
rdiff = RegionDifference(CurvesA=bounding_rectangle, CurvesB=fmerge.Breps)  # -> simplify(Result)
rint = RegionIntersection(CurvesA=runion, CurvesB=bounding_rectangle)
entwine = Entwine(Branch00=rint, Branch01=rdiff, FlattenInputs=True)  # -> simplify(Result)
split = SplitTree(Data=entwine, Masks=flatten(expression))  # -> Positive, Negative

# ----
a_fills = ClusterOutput(split.Positive)
b_fills = ClusterOutput(split.Negative)

# ==== cluster Cluster_28
tree_of_filtered_joined_pts = ClusterInput()
show_color_mapping = ClusterInput()
join_curves_inverted = ClusterInput()
bounding_rectangle = ClusterInput()
join_curves = ClusterInput()

# ---- group: Only compute Brep for difference if join curves are inverted
dispatch = Dispatch(List=join_curves, DispatchPattern=join_curves_inverted)  # -> ListA, ListB

# ---- group: Squares at each "tiedown" not in a join region
dispatch_2 = Dispatch(List=tree_of_filtered_joined_pts, DispatchPattern=show_color_mapping)  # -> ListA, ListB
rectangle = Rectangle(Plane=dispatch_2.ListA, XSize=Domain(-0.5, 0.5), YSize=Domain(-0.5, 0.5), Radius=0)  # -> Rectangle, Length

# ---- group: Only compute union if join curves are not inverted
not = GateNot(A=join_curves_inverted)
dispatch_3 = Dispatch(List=join_curves, DispatchPattern=not)  # -> ListA, ListB

# ----
circle = CircleCNR(Center=Point(-5, -5, 0), Normal=Vector(0, 0, 1), Radius=1)
boundary = BoundarySurfaces(Edges=[dispatch.ListA, circle])
fmerge = MergeFaces(Brep=boundary)  # -> Breps, Before, After
rdiff = RegionDifference(CurvesA=bounding_rectangle, CurvesB=fmerge.Breps)  # -> simplify(Result)
expression = Expression(a=join_curves_inverted, Expression="Format(\"{{{0}}}\", if (a=False, 0, 1))")

# ---- group: Union of inverted join curves and tiedowns v2 / Remove overlaps
rdiff_2 = RegionDifference(CurvesA=rdiff, CurvesB=flatten([rectangle.Rectangle, circle]))

# ---- group: Union of join curves and tiedowns
runion = RegionUnion(Curves=flatten([dispatch_3.ListA, circle, rectangle.Rectangle]))  # -> flatten(Result)

# ---- group: Union of inverted join curves and tiedowns v2
runion_2 = RegionUnion(Curves=[rdiff_2, rectangle.Rectangle])

# ----
entwine = Entwine(Branch00=runion, Branch01=runion_2, FlattenInputs=True)  # -> simplify(Result)
split = SplitTree(Data=entwine, Masks=flatten(expression))  # -> Positive, Negative

combined_joins_tiedowns = ClusterOutput(split.Positive)

# ==== cluster Cluster_30
all_points_on_all_layers = ClusterInput()
extent_x = ClusterInput()
extent_y = ClusterInput()

# ---- group: Find normal vector for each pt on layer 0
expression = Expression(y=extent_y, Expression="Format(\"{{?}}[{0}]\", y)")
split = SplitTree(Data=all_points_on_all_layers, Masks=flatten("{0;?}[?]"))  # -> Positive, Negative
clean = CleanTree(RemoveNulls=True, RemoveInvalid=True, RemoveEmpty=True, Tree=split.Positive)  # -> simplify(Tree)
expression_2 = Expression(x=extent_x, Expression="Format(\"{{{0}}}[?]\", x)")
relitem = RelativeItem(Tree=clean, Offset="{0}[-1]", WrapPaths=True, WrapItems=True)  # -> ItemA, ItemB
relitem_2 = RelativeItem(Tree=clean, Offset="{0}[1]", WrapPaths=True, WrapItems=True)  # -> ItemA, ItemB
relitem_3 = RelativeItem(Tree=clean, Offset="{-1}[0]", WrapPaths=True, WrapItems=True)  # -> ItemA, ItemB
relitem_4 = RelativeItem(Tree=clean, Offset="{1}[0]", WrapPaths=True, WrapItems=True)  # -> ItemA, ItemB
split_2 = SplitTree(Data=relitem_2.ItemB, Masks=flatten(expression))  # -> Positive, Negative
split_3 = SplitTree(Data=clean, Masks=flatten(expression))  # -> Positive, Negative
split_4 = SplitTree(Data=clean, Masks=flatten("{?}[0]"))  # -> Positive, Negative
split_5 = SplitTree(Data=relitem.ItemB, Masks=flatten("{?}[0]"))  # -> Positive, Negative
split_6 = SplitTree(Data=clean, Masks=flatten("{0}[?]"))  # -> Positive, Negative
split_7 = SplitTree(Data=relitem_3.ItemB, Masks=flatten("{0}[?]"))  # -> Positive, Negative
split_8 = SplitTree(Data=clean, Masks=flatten(expression_2))  # -> Positive, Negative
split_9 = SplitTree(Data=relitem_4.ItemB, Masks=flatten(expression_2))  # -> Positive, Negative
merge = Merge(Data1=split_2.Negative, Data2=split_3.Positive)
merge_2 = Merge(Data1=split_6.Positive, Data2=split_7.Negative)
merge_3 = Merge(Data1=split_4.Positive, Data2=split_5.Negative)
merge_4 = Merge(Data1=split_9.Negative, Data2=split_8.Positive)

# ---- group: Find normal vector for each pt on layer 0 / N pts
clean_2 = CleanTree(RemoveNulls=True, RemoveInvalid=True, RemoveEmpty=False, Tree=merge)

# ---- group: Find normal vector for each pt on layer 0 / S pts
clean_3 = CleanTree(RemoveNulls=True, RemoveInvalid=True, RemoveEmpty=False, Tree=merge_3)

# ---- group: Find normal vector for each pt on layer 0 / W pts
clean_4 = CleanTree(RemoveNulls=True, RemoveInvalid=True, RemoveEmpty=False, Tree=merge_2)

# ---- group: Find normal vector for each pt on layer 0 / E pts
clean_5 = CleanTree(RemoveNulls=True, RemoveInvalid=True, RemoveEmpty=False, Tree=merge_4)

# ---- group: Find normal vector for each pt on layer 0 (continued)
vec2pt = Vector2Pt(PointA=clean_3, PointB=clean_2, Unitize=False)  # -> Vector, Length
vec2pt_2 = Vector2Pt(PointA=clean_5, PointB=clean_4, Unitize=False)  # -> Vector, Length

# ---- group: Find normal vector for each pt on layer 0 / Normals for layer 0 pts
xprod = CrossProduct(VectorA=vec2pt.Vector, VectorB=vec2pt_2.Vector, Unitize=True)  # -> Vector, Length

# ----
normals_for_layer_0_pts = ClusterOutput(xprod.Vector)

# ==== cluster Cluster_31
layer_0_join_pts = ClusterInput()
layer_1_join_pts = ClusterInput()

# ---- group: Coincident - small spacing / Dummy line for when no joins
ln = Line(StartPoint=Point(0, 0, 0), EndPoint=Point(0, 0, 1))

# ---- group: Coincident - small spacing
ln_2 = Line(StartPoint=layer_0_join_pts, EndPoint=layer_1_join_pts)
merge = Merge(Data1=ln_2, Data2=ln)
length_line = LengthLine(Line=merge, Length=Slider(0.1, range=0..1), Strength=Slider(200, range=0..200))

# ----
join_goals = ClusterOutput(length_line)

# ==== cluster Cluster_32
column_bottoms = ClusterInput()
column_tops = ClusterInput()

# ---- group: Keep top & bottom of column vertical
geo = Geometry([column_tops, column_bottoms])
Z = UnitZ(Factor=1)
direction = Direction(Line=geo, Direction=Z, Strength=Slider(100, range=0..100))

# ----
column_top_bottom_direction_goals = ClusterOutput(direction)

# ==== cluster Cluster_33
lower_column_pts = ClusterInput()
upper_column_pts = ClusterInput()
lower_plane = ClusterInput()
upper_plane = ClusterInput()

# ---- group: Anchor top & bottom of column
number_slider = Slider(100, range=0..100)
onplane = OnPlane(Points=lower_column_pts, Plane=lower_plane, Strength=number_slider)
onplane_2 = OnPlane(Points=upper_column_pts, Plane=upper_plane, Strength=number_slider)
merge = Merge(Data1=onplane, Data2=onplane_2)

# ----
column_top_bottom_onplane_goals = ClusterOutput(merge)

# ==== cluster Cluster_34
column_bottoms = ClusterInput()
column_middles = ClusterInput()
column_tops = ClusterInput()

# ---- group: Keep stiffness of imaginary columns / Bottoms & middles
entwine = Entwine(Branch00=column_bottoms, Branch01=column_middles, FlattenInputs=True)  # -> simplify(Result)

# ---- group: Keep stiffness of imaginary columns / Middles & tops
entwine_2 = Entwine(Branch00=column_middles, Branch01=column_tops, FlattenInputs=True)  # -> simplify(Result)

# ---- group: Keep stiffness of imaginary columns
degrees_0 = Slider(60, range=0..180)
rad = Radians(Degrees=degrees_0)
clampangle = ClampAngle(LineA=entwine, LineB=entwine_2, UpperLimit=rad, LowerLimit="0", Strength=Slider(100, range=0..100))

# ----
column_stiffness_goals = ClusterOutput(clampangle)

# ==== cluster Cluster_35
all_points_on_all_layers_after_swaps = ClusterInput()

# ---- group: Create columns
relitem = RelativeItem(Tree=all_points_on_all_layers_after_swaps, Offset="{1;0}[0]", WrapPaths=False, WrapItems=False)  # -> ItemA, ItemB

# ---- group: Create columns / Lower plane & column pts
xy = XYPlane(Origin="0,0,-10")
move = Move(Geometry=relitem.ItemA, Motion="0,0,-10")  # -> Geometry, Transform

# ---- group: Create columns / Upper plane & column pts
move_2 = Move(Geometry=relitem.ItemB, Motion="0,0,10")  # -> Geometry, Transform
xy_2 = XYPlane(Origin="0,0,10")

# ---- group: Create columns / Column bottoms
ln = Line(StartPoint=move.Geometry, EndPoint=relitem.ItemA)  # -> flatten(Line)

# ---- group: Create columns / Column tops
ln_2 = Line(StartPoint=relitem.ItemB, EndPoint=move_2.Geometry)  # -> flatten(Line)

# ---- group: Create columns / Layer separation lines aka “middles”
ln_3 = Line(StartPoint=relitem.ItemA, EndPoint=relitem.ItemB)

# ----
lower_plane = ClusterOutput(move.Geometry)
upper_plane = ClusterOutput(xy_2)
column_tops = ClusterOutput(ln_2)
column_middles = ClusterOutput(ln_3)
column_bottoms = ClusterOutput(ln)
lower_column_pts = ClusterOutput(xy)
upper_column_pts = ClusterOutput(move_2.Geometry)

# ==== cluster Cluster_36
column_middles = ClusterInput()

# ---- group: Min. spacing bw all points
clamplength = ClampLength(
    Line=column_middles,
    LowerLimit=Slider(0.3, range=0..1),
    UpperLimit=Slider(4, range=0..20),
    Strength=Slider(45, range=0..100))

# ----
min_spacing_bw_pts_clamplength_goal = ClusterOutput(clamplength)

# ==== cluster Cluster_37
normal_vectors_for_layer_0_pts = ClusterInput()
column_middles = ClusterInput()

# ---- group: Keep layer offset in normal direction
direction = Direction(Line=column_middles, Direction=normal_vectors_for_layer_0_pts, Strength=Slider(100, range=0..100))

# ----
layer_offset_normal_direction_goal = ClusterOutput(direction)

# ==== cluster Cluster_38
extent_x = ClusterInput()
extent_y = ClusterInput()

# ---- group: Join pts around border
expression = Expression(x=extent_x, y=extent_y, Expression="Format(\"{{?;(0,{0})}}[?] {{?;?}}[(0,{1})]\", x,y)")
split = TextSplit(Text=expression, Separators=" ")

# ----
border_join_mask = ClusterOutput(split)

# ==== cluster Cluster_39
all_points_on_all_layers = ClusterInput()
pts_to_swap = ClusterInput()

# ---- group: Dummy text in case of empty set
panel = Panel("{99;?}[?]")

# ----
merge = Merge(Data1=pts_to_swap, Data2=panel)

# ---- group: Swap selected pts between layer 0 and 1
split = SplitTree(Data=all_points_on_all_layers, Masks=flatten(merge))  # -> Positive, Negative
path_mapper = PathMapper(split.Positive, source="{A;B}", target="{(A+1)%2;B}")
merge_2 = Merge(Data1=path_mapper, Data2=split.Negative)
clean = CleanTree(RemoveNulls=True, RemoveInvalid=True, RemoveEmpty=True, Tree=split.Positive)

# ---- group: Swap selected pts between layer 0 and 1 / All points on all layers, after swaps
clean_2 = CleanTree(RemoveNulls=True, RemoveInvalid=True, RemoveEmpty=True, Tree=merge_2)

# ----
all_points_on_all_layers_after_swaps = ClusterOutput(clean_2)
all_swap_pts = ClusterOutput(clean)

# ==== cluster Cluster_40
pts_to_filter_and_join = ClusterInput()
all_points_on_all_layers = ClusterInput()
pts_to_join_border_pts = ClusterInput()
border_join_mask = ClusterInput()
filter = ClusterInput()

# ---- group: Get join pt tree for each layer / Border pts
split = SplitTree(Data=all_points_on_all_layers, Masks=flatten(border_join_mask))  # -> Positive, Negative

# ---- group: Get join pt tree for each layer
pts_to_join_border_pts_2 = Relay([border_join_mask, pts_to_join_border_pts])
panel = Panel("{0;?}")

# ---- group: Get join pt tree for each layer / Mask applied to entire tree
split_2 = SplitTree(Data=all_points_on_all_layers, Masks=flatten(pts_to_join_border_pts_2))  # -> Positive, Negative

# ---- group: Get join pt tree for each layer / Filter all points not already joined
split_3 = SplitTree(Data=split_2.Negative, Masks=flatten(filter))  # -> Positive, Negative

# ---- group: Get join pt tree for each layer / Selection curve mask applied to filtered not-already-joined pt tree - this prevents duplicates
split_4 = SplitTree(Data=split_3.Positive, Masks=flatten(pts_to_filter_and_join))  # -> Positive, Negative

# ---- group: Get join pt tree for each layer / Only use layer 0 pts
split_5 = SplitTree(Data=[split_4.Positive, split.Positive], Masks=flatten(panel))  # -> Positive, Negative

# ---- group: Get join pt tree for each layer (continued)
merge = Merge(Data1=split_2.Positive, Data2=split_4.Positive)
clean = CleanTree(RemoveNulls=True, RemoveInvalid=True, RemoveEmpty=True, Tree=split_5.Positive)

# ---- group: Get join pt tree for each layer / Joined pts
clean_2 = CleanTree(RemoveNulls=True, RemoveInvalid=True, RemoveEmpty=False, Tree=merge)

# ---- group: Get join pt tree for each layer (continued)
relitem = RelativeItem(Tree=clean_2, Offset="{1;0}[0]", WrapPaths=False, WrapItems=False)  # -> ItemA, ItemB

# ----
layer_0_join_pts = ClusterOutput(relitem.ItemA)
layer_1_join_pts = ClusterOutput(relitem.ItemB)
tree_of_filtered_joined_pts = ClusterOutput(clean)
